# Grasshopper definition AIA_GeoOpt_Assignment02_setup.gh (Grasshopper 1.0.7)

panel = Panel("https://raw.githubusercontent.com/Fromero8706/AIA---GeoOpt/main/A1/test.py")
python = GhPythonScript(fetch=Button(), url=panel)  # -> out, raw; inputs fetch: Boolean
# ---------- python: Python ----------
"""Provides a scripting component that fetches the python code from a github repository.
    Inputs:
        fetch: Boolean to fetch
        url: The url of the raw python file in github
    Output:
        raw: Outputs the code"""

__author__ = "davidandresleon"
__version__ = "2021.04.04"


import clr
clr.AddReference('System.Web.Extensions')
from System.Web.Script.Serialization import JavaScriptSerializer
from System.Net import WebClient


if fetch:

    # Create a web client
    client = WebClient()
    
    # Download the results of that URL
    results = client.DownloadString(url)
    # output these results
    
raw =  results
# ---------- end python ----------
# Assignment 2
python_2 = GhPythonScript(x=Slider(10, range=1..20), y=Slider(10, range=1..20), U=Slider(20, range=1..20), V=Slider(20, range=1..20))  # -> out, a, c, d, e, f, g, h; inputs x: Int32, U: Int32, V: Int32
# ---------- python_2: Python ----------
import Rhino.Geometry as rg
import ghpythonlib.treehelpers as th
import math
import ghpythonlib.components as ghc

#this is how you initialize a list in python
pointList1 = []
pointList2 = []
for i in range(x):
    pt1 = rg.Point3d(i, 0, 0)
    pt2 = rg.Point3d(i, y, 0)
    pointList1.append(pt1)
    pointList2.append(pt2)

a = pointList1

lineList = []
for i in range(len(pointList1)):
    line = rg.Line(pointList1[i], pointList2[i])
    lineList.append(line)
c = lineList


allDivPts = []
for l in lineList:
    divPts = [] #my list of division points
    nc = l.ToNurbsCurve()
    params = nc.DivideByCount(V, True)
    for p in params:
        divPt = nc.PointAt(p)
        
        vec= rg.Vector3d(divPt)
        vecLen = vec.Length
        mag = math.sin(vecLen)
        transVec = -rg.Vector3d.ZAxis * mag
        
        newPt = divPt - transVec
        divPts.append(newPt)

    allDivPts.append(divPts)

d = th.list_to_tree(allDivPts)


#make a curve from list of points
curveList = []
for i in range(len(allDivPts)):
    curve = rg.Curve.CreateInterpolatedCurve(allDivPts[i], 3)
    curveList.append(curve)
e= curveList


#create a loft surface from curves
surface = rg.Brep.CreateFromLoft(curveList, rg.Point3d.Unset, rg.Point3d.Unset, rg.LoftType.Normal, False)
surface = surface[0].Faces[0]

f = surface

#reparametrize surface
surface.SetDomain(0,rg.Interval(0,U))
surface.SetDomain(1,rg.Interval(0,V))

#get points
allSrfPts=[]
for i in range(U+1):
    srfPts= []
    for j in range(V+1):
        pt=rg.Surface.PointAt(surface,i,j)
        srfPts.append(pt)
    allSrfPts.append(srfPts)
h = allSrfPts


mesh = rg.Mesh()
for i in range(len(allSrfPts)-1):
    for j in range(len(allSrfPts[i])-1):
        m = rg.Mesh()
        v1 = allSrfPts[i][j]
        v2 = allSrfPts[i][j+1]        
        v3 = allSrfPts[i+1][j+1]        
        v4 = allSrfPts[i+1][j]
        
        m.Vertices.Add(v1)
        m.Vertices.Add(v2)
        m.Vertices.Add(v3)
        m.Vertices.Add(v4)
        
        m.Faces.AddFace(0,1,2,3)
        
        mesh.Append(m)

g = mesh

cleanmesh = mesh
#methods to clean a mesh
cleanmesh.Normals.ComputeNormals()
cleanmesh.Vertices.CombineIdentical(True, True)
cleanmesh.Vertices.CullUnused()
cleanmesh.Weld(3.14159265358979)
cleanmesh.UnifyNormals()
cleanmesh.FaceNormals.ComputeFaceNormals()
cleanmesh.Compact()


h = cleanmesh
# ---------- end python_2 ----------
python_3 = GhPythonScript(Code=python.raw)  # -> Out, A

# ---- group: create sun Vector
python_4 = GhPythonScript(x=Slider(0.09, range=0..1), y=Slider(0.54, range=0..1))  # -> out, a, b, c
# ---------- python_4: Python ----------
import Rhino.Geometry as rg
import math
import rhinoscriptsyntax as rs

#create a sun vector

#1. create a Sphere at point (0,0,0) with radius 1 and output it to a
#output the sphere to a

#a = sphere
center = rg.Point3d(0,0,0)
print (center)
a = rg.Sphere(center,1)

#2. evaluate a point in the sphere using rg.Sphere.PointAt() at coordintes x and y
#the point should only be on the upper half of the sphere (upper hemisphere)
#the angles are in radians, so you might want to use math.pi for this
#output the point to b

#b = point
b = rg.Sphere.PointAt(a, x*2*math.pi, y*math.pi)
c = math.pi*b*2
print(b)


#create a vector from the origin  and reverse the vector
#keep in mind that Reverse affects the original vector
#output the vector to c

#c = vec
c = rg.Vector3d(b)
c = rg.Vector3d.Negate(c)
print(c)
# ---------- end python_4 ----------

# ---- group: replaceable mesh
mesh = Data(python_2.h)

# ---- group: your .py file goes here
path = FilePath("C:\Users\kimky\Desktop\AIA-GeoOpt\AIA-GeoOpt\a01\Assignment 02.py")

# ----
file = ReadFile(File=path, PerLineParse=True)
vdis = VectorDisplay(Anchor=python_4.b, Vector=python_4.c)
ghpython_script = GhPythonScript(m=mesh, max_r=Slider(0.2, range=0..1), min_r=Slider(0.08, range=0..0.1))  # -> out, a, b, c, d, e, f, g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; inputs m: Mesh, s: Vector3d
# ---------- ghpython_script: Python ----------
import rhinoscriptsyntax as rs
import Rhino.Geometry as rg
import ghpythonlib.treehelpers as th 
import math

#1.
#compute face normals using rg.Mesh.FaceNormals.ComputeFaceNormals()
#output the vectors to a

m.FaceNormals.ComputeFaceNormals()
meshNormals=m.FaceNormals
#2.
#get the centers of each faces using rg.Mesh.Faces.GetFaceCenter()
#store the centers into a list called centers 
#output that list to b

centers = []
faces = m.Faces

print (type(faces))
for i in range(len(faces)):
    center = m.Faces.GetFaceCenter(i)
    centers.append(center)
b = centers

#3.
#calculate the angle between the sun and each FaceNormal using rg.Vector3d.VectorAngle()
#store the angles in a list called angleList and output it to c
angleList=[]
for i in meshNormals:
    angle = rg.Vector3d.VectorAngle(s,i)
    angleList.append(angle)
c = angleList

#4. explode the mesh - convert each face of the mesh into a mesh
#for this, you have to first copy the mesh using rg.Mesh.Duplicate()
#then iterate through each face of the copy, extract it using rg.Mesh.ExtractFaces
#and store the result into a list called exploded in output d

exploded = []
meshcopy = m.Duplicate()
print meshcopy.Faces.Count

for i in range(meshcopy.Faces.Count):
    extractface = meshcopy.Faces.ExtractFaces([0])
    exploded.append(extractface)
d = exploded

#after here, your task is to apply a transformation to each face of the mesh
#the transformation should correspond to the angle value that corresponds that face to it... 
#the result should be a mesh that responds to the sun position... its up to you!


# Get bound of each mesh face
outlines=[]
for i in exploded:
    outline=rg.Mesh.GetNakedEdges(i)
    outlines.append(outline)
# Join outlines
joined_outlines=[]
for i in outlines:
    curves=[]
    for j in i:
        curve=rg.Polyline.ToNurbsCurve(j)
        curves.append(curve)
    joined=rg.Curve.JoinCurves(curves)[0]
    joined_outlines.append(joined)
# Remap angleList
remaped_angles=[]
for i in angleList:
    remaped_value = (((i - min(angleList)) * (max_r - min_r)) / (max(angleList) - min(angleList))) + min_r
    remaped_angles.append(remaped_value)

#Draw circles

circles=[]
for i in range(len(centers)):
    circle=rg.Circle(centers[i],remaped_angles[i])
    circles.append(circle)

#project circles
project_circles=[]
for i in range(len(circles)):
    curve=rg.Circle.ToNurbsCurve(circles[i])
    start_point=rg.Curve.PointAt(joined_outlines[i],0)
    t_p=rg.Curve.ClosestPoint(curve,start_point,3)[1]
    projected=rg.Curve.ProjectToMesh(curve,exploded[i],rg.Vector3d.ZAxis,.001)[0]
    project_circles.append(projected)
## get mesh points
lofted=[]
for i in range(len(project_circles)):
    curve=project_circles[i]
    s_P=curve.PointAt(0)
    rg.Curve.DoDirectionsMatch(joined_outlines[i],curve)
    t_p=rg.PolyCurve.ClosestPoint(joined_outlines[i],s_P,4)[1]
    rg.Curve.ChangeClosedCurveSeam(joined_outlines[i],t_p)
    listl=[curve,joined_outlines[i]]
    loft=rg.Brep.CreateFromLoft(listl,rg.Point3d.Unset,rg.Point3d.Unset,rg.LoftType.Normal,False)[0]
    lofted.append(loft)
# ---------- end ghpython_script ----------
python_5 = GhPythonScript(m=mesh, s=python_4.c, max_r=Slider(0.1, range=0..1), min_r=Slider(0.1, range=0..0.1))  # -> out, a, b, c, d, E, circles, re_angles, joined_lines, outlines; inputs m: Mesh, s: Vector3d
# ---------- python_5: Python ----------
import Rhino.Geometry as rg

#1.
#compute face normals using rg.Mesh.FaceNormals.ComputeFaceNormals()
#output the vectors to a

#a = faceNormals
a = []
num_faces = len(m.Faces)
#print(num_face)
for i in range(num_faces):
    normalsFace= m.FaceNormals[i]
    reverse_norm=rg.Vector3d.Negate(normalsFace)
    a.append(reverse_norm)
print type(a)


#2.
#get the centers of each faces using rg.Mesh.Faces.GetFaceCenter()
#store the centers into a list called centers 
#output that list to b
#b = centers

b = []
for j in range(num_faces):
    faceCenter= m.Faces.GetFaceCenter(j)
    b.append(faceCenter)
    


#3.
#calculate the angle between the sun and each FaceNormal using rg.Vector3d.VectorAngle()
#store the angles in a list called angleList and output it to c

#c = angleList

c = []
for k in range(num_faces):
    angle = rg.Vector3d.VectorAngle(a[k], s)
    c.append(angle)


#4. explode the mesh - convert each face of the mesh into a mesh
#for this, you have to first copy the mesh using rg.Mesh.Duplicate()
#then iterate through each face of the copy, extract it using rg.Mesh.ExtractFaces
#and store the result into a list called exploded in output d

#d = exploded

d = []
meshDupli = m.Duplicate()
print meshDupli.Faces.Count

for m in range(len(rg.Mesh.Duplicate(m).Faces)):
   faceMesh = meshDupli.Faces.ExtractFaces([0])
   d.append(faceMesh)
print(type(d))

#after here, your task is to apply a transformation to each face of the mesh
#the transformation should correspond to the angle value that corresponds that face to it... 
#the result should be a mesh that responds to the sun position... its up to you!

"""
--------------------
Bonus tasks"""

#edge mesh edge
outlines = []
for l in d:
    outline = rg.Mesh.GetNakedEdges(l)
    outlines.append(outline)

#Join lines
joined_lines = []
for p in outlines:
    curves = []
    for j in p :
       curve = rg.Polyline.ToNurbsCurve(j)
       curves.append(curve)
    joined = rg.Curve.JoinCurves(curves)[0]
    joined_lines.append(joined)
    
# Remap anglelist
re_angles =[]
for i in c:
    re_value = (((i - min(c)) * (max_r - min_r)) / (max(c) - min(c))) + min_r
    re_angles.append(re_value)

#Circles
circles = []
for i in range(len(b)):
    circle = rg.Circle(b[i], re_angles[i])
    circles.append(circle)
# ---------- end python_5 ----------
bnd = Bounds(Numbers=python_5.c)
panel_2 = Panel(python_5.out)
data = Data(ghpython_script.joined_outlines)
data_2 = Data(ghpython_script.lofted)
data_3 = Data(ghpython_script.project_circles)
dedomain = DeconstructDomain(Domain=bnd)  # -> Start, End
gradient = Gradient(
    LowerLimit=dedomain.Start,
    UpperLimit=dedomain.End,
    Parameter=python_5.c,
    stops=[0: RGB(234, 38, 0), 0.25: RGB(234, 126, 0), 0.5: RGB(254, 244, 84), 0.75: RGB(173, 203, 249), 1: RGB(75, 107, 169)])
vdis_2 = VectorDisplay(Anchor=python_5.b, Vector=python_5.a)
preview = CustomPreview(Geometry=python_5.d, Material=gradient)
